# Dynamo graph Building Generator.dyn (Dynamo 2.0.2.6826)

XY = Plane.XY()
string = StringInput("U")
length = DoubleSlider(20, range=0..100 step 1)
width = DoubleSlider(20, range=0..100 step 1)
depth = DoubleSlider(8, range=0..30 step 1)
total_floor_area = DoubleSlider(339, range=0..10000 step 1)
floor_height = DoubleSlider(11, range=0..40 step 1)
boolean = BoolSelector(false)
buildingGenerator = Buildings.Creation.BuildingGenerator(BasePlane=XY, Type=string, Length=length, Width=width, Depth=depth, BldgArea=total_floor_area, FloorHeight=floor_height, CreateCore=boolean)
angle_threshold = DoubleSlider(45, range=0..180 step 1)
deceonstructFacadeShell = Buildings.Analysis.DeceonstructFacadeShell(Mass=buildingGenerator.Mass, AngleThreshold=angle_threshold)
byJoinedSurfaces = PolySurface.ByJoinedSurfaces(surfaces=deceonstructFacadeShell.HorizontalSurfaces)
byJoinedSurfaces_2 = PolySurface.ByJoinedSurfaces(surfaces=deceonstructFacadeShell.VerticalSurfaces)
bySolid = PolySurface.BySolid(solid=buildingGenerator.Mass)
siteContext = Site.Analysis.SiteContext(RevitSite=bySolid)
toCuboid = BoundingBox.ToCuboid(boundingBox=siteContext.BoundingBoxes)
watch = Watch(siteContext.Heights)
code_block = CodeBlock()
# ---------- code_block.designscript (6 lines) ----------
[
	Point.ByCoordinates(30, 0),
	Point.ByCoordinates(0, 30),
	Point.ByCoordinates(-30, 0),
	Point.ByCoordinates(0, -18)
];
# ----------------------------------------
boolean_2 = BoolSelector(true)
byControlPoints = NurbsCurve.ByControlPoints(points=code_block, closeCurve=boolean_2)
setback = DoubleSlider(3, range=0..20 step 1)
max_height = DoubleSlider(50, range=0..500 step 1)
siteMassGenerator = Site.Creation.SiteMassGenerator(SiteOutline=byControlPoints, Setback=setback, HeightLimit=max_height)
siteClashTest = Site.Analysis.SiteClashTest(BuildingMass=buildingGenerator.Mass, SiteBoundary=siteMassGenerator.SiteMass)
watch_2 = Watch(siteClashTest.Percent)
watch_3 = Watch(siteClashTest.DoesIntersect)
